# Grasshopper definition Simple.ghx (Grasshopper 1.0.7)
# plug-ins: Caribou

panel = Panel("addr:street=Taranaki Street")
panel_2 = Panel("building")
panel_3 = Panel("cuisine=mexican")
panel_4 = Panel("highway=traffic_signals")
specify_features = SpecifyFeatures(selectionIncludesObscure=True, selectionSerialised="aerialway=*,aeroway=*,amenity=*")  # -> OSMFeatures, Debug

# ---- group: Melbourne CBD
path = FilePath(["Z:\Sites\Caribou\Caribou.Tests\Cases\melbourne.xml", "/Users/philip/Sites/Caribou/Caribou.Tests/Cases/melbourne.xml"])

# ---- group: Wellington CBD
path_2 = FilePath(["/Users/philip/Sites/Caribou/Caribou.Tests/Cases/wellington-overpass-export.osm", "Z:\Sites\Caribou\Caribou.Tests\Cases\wellington-overpass-export.osm"])

# ----
path_3 = FilePath(path_2)
text = Text(specify_features.OSMFeatures)
extract_ways = ExtractWays(OSMFilePath=path_3, OSMFeatures=text)  # -> Ways, Tags, Report, Debug
extract_nodes = ExtractNodes(OSMFilePath=path_3, OSMFeatures=text)  # -> Nodes, Tags, Report, Debug
report = Panel(extract_nodes.Report)
data = Data([extract_ways.Report, extract_nodes.Report])
list_item = ListItem(List=data, Index="3", Wrap=True)  # -> flatten(Item)
list_item_2 = ListItem(List=data, Index="0", Wrap=True)  # -> flatten(Item)

# ---- group: Visualise in Grasshopper with Per-Feature Colors
data_2 = Data(extract_ways.Ways)
data_3 = Data(extract_nodes.Nodes)
rectangle = Rectangle({Plane=PlaneXY(2657819.891, 4006251.231, 0), Size=Domain2(u=-387259.1388..387259.1388, v=-1366045.973..1366045.973)})
legend = Legend(Colour=list_item, Tags=list_item_2, Rectangle=rectangle, LegendType=1)
custom_preview = CustomPreview(
    Geometry=data_2,
    Material={diffuse=RGB(221, 160, 221), emission=RGB(66, 48, 66), shine=0.5, specular=RGB(255, 255, 255), transparency=0})
custom_preview_2 = CustomPreview(
    Geometry=data_3,
    Material={diffuse=RGB(221, 160, 221), emission=RGB(66, 48, 66), shine=0.5, specular=RGB(255, 255, 255), transparency=0})
